# Grasshopper definition builder.gh (Grasshopper 1.0.8)

py3 = Python3Script()  # -> out, a, b, c, d
# ---------- py3: Python ----------
import scriptcontext as sc

a,b,c,d= sc.sticky["Junction"]


print (a)
print (b)
print ()
# ---------- end py3 ----------
py3_2 = Python3Script(generate_layer=Button())  # inputs generate_layer: Boolean
# ---------- py3_2: Python ----------
import sys, os, inspect

root = os.path.dirname(inspect.getsourcefile(lambda: 0))
if root not in sys.path:
    sys.path.insert(0, root)

import get_road_data
if generate_layer:
    get_road_data.ensure_road_layers()
# ---------- end py3_2 ----------

# ---- group: RoadNetwork & Block Builder
roadnetwork_block = Python3Script(script=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)  # -> out, road_network, blocks; inputs GENERATE: list; unedited script template

# ----
py3_3 = Python3Script()  # -> block_infos
# ---------- py3_3: Python ----------
import units
from units import BlockInfo

example_landuse_data = {
    "type_A": {
        "block_ids": [1, 2, 3],
        "gfa": 5.0,  # 용적률
        "bcr": 0.45,  # 건폐율
        "landuses": ["residential", "retail"],
        "pedestrian_width": 3.0,
    },
    "type_B": {
        "block_ids": [4, 5],
        "gfa": 7.5,
        "bcr": 0.55,
        "landuses": ["office", "retail"],
        "pedestrian_width": 4.0,
    },
    "type_C": {
        "block_ids": [6, 7],
        "gfa": 3.5,
        "bcr": 0.35,
        "landuses": ["park", "community"],
        "pedestrian_width": 2.0,
    },
}

# 딕셔너리 데이터를 사용하여 BlockInfo 객체 생성
block_info_A = BlockInfo(**example_landuse_data["type_A"])
block_info_B = BlockInfo(**example_landuse_data["type_B"])
block_info_C = BlockInfo(**example_landuse_data["type_C"])

block_infos = [block_info_A, block_info_B, block_info_C]
# ---------- end py3_3 ----------
panel = Panel(roadnetwork_block.out)

# ---- group: LandUse Setting
landuse = Python3Script(script=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, blocks=roadnetwork_block.blocks, block_infos=py3_3)  # -> blocks, road_network; inputs blocks: list, block_infos: list; unedited script template

landuse_2 = Python3Script(script=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, blocks=landuse.blocks, road_network=landuse.road_network)  # -> blocks, road_network; inputs blocks: list; unedited script template
